# Grasshopper definition RoomDataSheet-Formatting.gh (Grasshopper 1.0.7)
# plug-ins: Human

number_slider = Slider(8.5, range=0..10)
point = Point(Point(4.149027661, -6.371211943, 1.9002715))
negative = Negative(Value=Slider(11, range=0..100))
rectangle = Rectangle(Plane=point, XSize=number_slider, YSize=negative, Radius=0)  # -> Rectangle, Length
data = Data(rectangle.Rectangle)

data_2 = Data(data)
md_slider = MDSlider(
    SliderMode=0,
    slider_value=Point(0, 0.7525824653, 0.5),
    x_domain=Domain(0, 1),
    y_domain=Domain(0, 1),
    z_domain=Domain(0, 1))
data_3 = Data(data)
md_slider_2 = MDSlider(
    SliderMode=0,
    slider_value=Point(0, 0.7525824653, 0.5),
    x_domain=Domain(0, 1),
    y_domain=Domain(0, 1),
    z_domain=Domain(0, 1))
evaluate_surface = EvaluateSurface(Surface=reparameterize(data_2), Point=md_slider)  # -> Point, Normal, UDirection, VDirection, Frame
evaluate_surface_2 = EvaluateSurface(Surface=reparameterize(data_3), Point=md_slider_2)  # -> Point, Normal, UDirection, VDirection, Frame
rectangle_2 = Rectangle(Plane=evaluate_surface.Point, XSize=number_slider, YSize=negative, Radius=0)  # -> Rectangle, Length
rectangle_3 = Rectangle(Plane=evaluate_surface_2.Point, XSize=number_slider, YSize=negative, Radius=0)  # -> Rectangle, Length
data_4 = Data(rectangle_2.Rectangle)
data_5 = Data(rectangle_3.Rectangle)
data_6 = Data(rectangle_3.Rectangle)
data_7 = Data(rectangle_2.Rectangle)
data_8 = Data(rectangle_2.Rectangle)
md_slider_3 = MDSlider(
    SliderMode=0,
    slider_value=Point(0.1152639289, 0.6556803385, 0.5),
    x_domain=Domain(0, 1),
    y_domain=Domain(0, 1),
    z_domain=Domain(0, 1))
md_slider_4 = MDSlider(
    SliderMode=0,
    slider_value=Point(0.8714394017, 0.6398414249, 0.5),
    x_domain=Domain(0, 1),
    y_domain=Domain(0, 1),
    z_domain=Domain(0, 1))
md_slider_5 = MDSlider(
    SliderMode=0,
    slider_value=Point(0.1411505448, 0.6337960379, 0.5),
    x_domain=Domain(0, 1),
    y_domain=Domain(0, 1),
    z_domain=Domain(0, 1))
md_slider_6 = MDSlider(
    SliderMode=0,
    slider_value=Point(0.8858012952, 0.6633936322, 0.5),
    x_domain=Domain(0, 1),
    y_domain=Domain(0, 1),
    z_domain=Domain(0, 1))
md_slider_7 = MDSlider(
    SliderMode=0,
    slider_value=Point(0.1320852179, 0.6659698971, 0.5),
    x_domain=Domain(0, 1),
    y_domain=Domain(0, 1),
    z_domain=Domain(0, 1))
evaluate_surface_3 = EvaluateSurface(Surface=reparameterize(data_4), Point=md_slider_3)  # -> Point, Normal, UDirection, VDirection, Frame
evaluate_surface_4 = EvaluateSurface(Surface=reparameterize(data_5), Point=md_slider_4)  # -> Point, Normal, UDirection, VDirection, Frame
evaluate_surface_5 = EvaluateSurface(Surface=reparameterize(data_6), Point=md_slider_5)  # -> Point, Normal, UDirection, VDirection, Frame
evaluate_surface_6 = EvaluateSurface(Surface=reparameterize(data_7), Point=md_slider_6)  # -> Point, Normal, UDirection, VDirection, Frame
evaluate_surface_7 = EvaluateSurface(Surface=reparameterize(data_8), Point=md_slider_7)  # -> Point, Normal, UDirection, VDirection, Frame
point_2 = Point(evaluate_surface_3.Point)
point_3 = Point(evaluate_surface_4.Point)
point_4 = Point(evaluate_surface_5.Point)
point_5 = Point(evaluate_surface_6.Point)
point_6 = Point(evaluate_surface_7.Point)
data_9 = Data(point_4)
data_10 = Data(point_5)
data_11 = Data(point_6)
panel = Panel("""Requirement 1
ada requirement?
occupancy requirement?
security requirement?""")
number_slider_2 = Slider(0, range=0..100)
number_slider_3 = Slider(0, range=0..100)
data_12 = Data(point_3)
unit_x = UnitX(Factor=1)
justifiedtext3d = JustifiedText3d(
    Location=data_9,
    Text=panel,
    Size=Slider(0.12, range=0..1),
    HorizontalAlignment=number_slider_2,
    VerticalAlginment=number_slider_2,
    Font="Arial",
    UseMeshes=False,
    Bake=False)
panel_2 = Panel("""Requirement 1
ada requirement?
occupancy requirement?
security requirement?""")
justifiedtext3d_2 = JustifiedText3d(
    Location=data_10,
    Text="Description",
    Size=Slider(0.14, range=0..1),
    HorizontalAlignment=Slider(2, range=0..10),
    VerticalAlginment=Slider(0, range=0..100),
    Font="Arial",
    UseMeshes=False,
    Bake=False)
justifiedtext3d_3 = JustifiedText3d(
    Location=data_11,
    Text="Special Requirements",
    Size=Slider(0.14, range=0..1),
    HorizontalAlignment=number_slider_3,
    VerticalAlginment=number_slider_3,
    Font="Arial",
    UseMeshes=False,
    Bake=False)
line_sdl = LineSDL(Start=point_2, Direction=unit_x, Length=Slider(6.58, range=0..100))
list_length = ListLength(List=panel_2)
series = Series(Start=0, Step=Slider(0.2, range=0..1), Count=list_length)
unit_y = UnitY(Factor=series)
reverse = Reverse(Vector=unit_y)
move = Move(Geometry=data_12, Motion=reverse)  # -> Geometry, Transform
justifiedtext3d_4 = JustifiedText3d(
    Location=move.Geometry,
    Text=panel_2,
    Size=Slider(0.12, range=0..1),
    HorizontalAlignment=Slider(2, range=0..10),
    VerticalAlginment=Slider(1, range=0..100),
    Font="Arial",
    UseMeshes=False,
    Bake=False)

data_13 = Data(data)
md_slider_8 = MDSlider(
    SliderMode=0,
    slider_value=Point(0.02685482627, 0.9852740575, 0.5),
    x_domain=Domain(0, 1),
    y_domain=Domain(0, 1),
    z_domain=Domain(0, 1))
evaluate_surface_8 = EvaluateSurface(Surface=reparameterize(data_13), Point=md_slider_8)  # -> Point, Normal, UDirection, VDirection, Frame
rectangle_4 = Rectangle(Plane=evaluate_surface_8.Point, XSize=number_slider, YSize=negative, Radius=0)  # -> Rectangle, Length
data_14 = Data(rectangle_4.Rectangle)
data_15 = Data(rectangle_4.Rectangle)
data_16 = Data(rectangle_4.Rectangle)
data_17 = Data(rectangle_4.Rectangle)
data_18 = Data(rectangle_4.Rectangle)
md_slider_9 = MDSlider(
    SliderMode=0,
    slider_value=Point(0.09697522615, 0.8575559586, 0.5),
    x_domain=Domain(0, 1),
    y_domain=Domain(0, 1),
    z_domain=Domain(0, 1))
md_slider_10 = MDSlider(
    SliderMode=0,
    slider_value=Point(0.09697522615, 0.8208573599, 0.5),
    x_domain=Domain(0, 1),
    y_domain=Domain(0, 1),
    z_domain=Domain(0, 1))
md_slider_11 = MDSlider(
    SliderMode=0,
    slider_value=Point(0.09697522615, 0.7849384611, 0.5),
    x_domain=Domain(0, 1),
    y_domain=Domain(0, 1),
    z_domain=Domain(0, 1))
md_slider_12 = MDSlider(
    SliderMode=0,
    slider_value=Point(0.09697522615, 0.7609925285, 0.5),
    x_domain=Domain(0, 1),
    y_domain=Domain(0, 1),
    z_domain=Domain(0, 1))
md_slider_13 = MDSlider(
    SliderMode=0,
    slider_value=Point(0.09697522615, 0.7342285156, 0.5),
    x_domain=Domain(0, 1),
    y_domain=Domain(0, 1),
    z_domain=Domain(0, 1))
evaluate_surface_9 = EvaluateSurface(Surface=reparameterize(data_14), Point=md_slider_9)  # -> Point, Normal, UDirection, VDirection, Frame
evaluate_surface_10 = EvaluateSurface(Surface=reparameterize(data_15), Point=md_slider_10)  # -> Point, Normal, UDirection, VDirection, Frame
evaluate_surface_11 = EvaluateSurface(Surface=reparameterize(data_16), Point=md_slider_11)  # -> Point, Normal, UDirection, VDirection, Frame
evaluate_surface_12 = EvaluateSurface(Surface=reparameterize(data_17), Point=md_slider_12)  # -> Point, Normal, UDirection, VDirection, Frame
evaluate_surface_13 = EvaluateSurface(Surface=reparameterize(data_18), Point=md_slider_13)  # -> Point, Normal, UDirection, VDirection, Frame
point_7 = Point(evaluate_surface_9.Point)
point_8 = Point(evaluate_surface_10.Point)
point_9 = Point(evaluate_surface_11.Point)
point_10 = Point(evaluate_surface_12.Point)
point_11 = Point(evaluate_surface_13.Point)
panel_3 = Panel("__125 SQFT")
padtext = PadText()
data_19 = Data(point_7)
data_20 = Data(point_8)
data_21 = Data(point_9)
data_22 = Data(point_10)
data_23 = Data(point_11)
number_slider_4 = Slider(0, range=0..100)
number_slider_5 = Slider(0, range=0..100)
number_slider_6 = Slider(0, range=0..100)
number_slider_7 = Slider(0, range=0..100)
number_slider_8 = Slider(0, range=0..100)
justifiedtext3d_5 = JustifiedText3d(
    Location=data_19,
    Text="REC ROOM",
    Size=Slider(0.25, range=0..1),
    HorizontalAlignment=number_slider_4,
    VerticalAlginment=number_slider_4,
    Font="Arial",
    UseMeshes=False,
    Bake=False)
justifiedtext3d_6 = JustifiedText3d(
    Location=data_20,
    Text="  125 SQFT",
    Size=Slider(0.2, range=0..1),
    HorizontalAlignment=number_slider_5,
    VerticalAlginment=number_slider_5,
    Font="Arial",
    UseMeshes=False,
    Bake=False)
justifiedtext3d_7 = JustifiedText3d(
    Location=data_21,
    Text="BUILDING: ISB",
    Size=Slider(0.14, range=0..1),
    HorizontalAlignment=number_slider_6,
    VerticalAlginment=number_slider_6,
    Font="Arial",
    UseMeshes=False,
    Bake=False)
justifiedtext3d_8 = JustifiedText3d(
    Location=data_22,
    Text="LEVEL: 1",
    Size=Slider(0.14, range=0..1),
    HorizontalAlignment=number_slider_7,
    VerticalAlginment=number_slider_7,
    Font="Arial",
    UseMeshes=False,
    Bake=False)
justifiedtext3d_9 = JustifiedText3d(
    Location=data_23,
    Text="VERTICAL CIRCULATION",
    Size=Slider(0.14, range=0..1),
    HorizontalAlignment=number_slider_8,
    VerticalAlginment=number_slider_8,
    Font="Arial",
    UseMeshes=False,
    Bake=False)

data_24 = Data(data)
data_25 = Data(data)
data_26 = Data(data)
data_27 = Data(data)
data_28 = Data(data)
md_slider_14 = MDSlider(
    SliderMode=0,
    slider_value=Point(0.8714394017, 0.6456883991, 0.5),
    x_domain=Domain(0, 1),
    y_domain=Domain(0, 1),
    z_domain=Domain(0, 1))
md_slider_15 = MDSlider(
    SliderMode=0,
    slider_value=Point(0.1152639289, 0.6556803385, 0.5),
    x_domain=Domain(0, 1),
    y_domain=Domain(0, 1),
    z_domain=Domain(0, 1))
md_slider_16 = MDSlider(
    SliderMode=0,
    slider_value=Point(0.1358873869, 0.6198265439, 0.5),
    x_domain=Domain(0, 1),
    y_domain=Domain(0, 1),
    z_domain=Domain(0, 1))
md_slider_17 = MDSlider(
    SliderMode=0,
    slider_value=Point(0.8858012952, 0.6633936322, 0.5),
    x_domain=Domain(0, 1),
    y_domain=Domain(0, 1),
    z_domain=Domain(0, 1))
md_slider_18 = MDSlider(
    SliderMode=0,
    slider_value=Point(0.1320852179, 0.6659698971, 0.5),
    x_domain=Domain(0, 1),
    y_domain=Domain(0, 1),
    z_domain=Domain(0, 1))
evaluate_surface_14 = EvaluateSurface(Surface=reparameterize(data_24), Point=md_slider_14)  # -> Point, Normal, UDirection, VDirection, Frame
evaluate_surface_15 = EvaluateSurface(Surface=reparameterize(data_25), Point=md_slider_15)  # -> Point, Normal, UDirection, VDirection, Frame
evaluate_surface_16 = EvaluateSurface(Surface=reparameterize(data_26), Point=md_slider_16)  # -> Point, Normal, UDirection, VDirection, Frame
evaluate_surface_17 = EvaluateSurface(Surface=reparameterize(data_27), Point=md_slider_17)  # -> Point, Normal, UDirection, VDirection, Frame
evaluate_surface_18 = EvaluateSurface(Surface=reparameterize(data_28), Point=md_slider_18)  # -> Point, Normal, UDirection, VDirection, Frame
point_12 = Point(evaluate_surface_14.Point)
point_13 = Point(evaluate_surface_15.Point)
point_14 = Point(evaluate_surface_16.Point)
point_15 = Point(evaluate_surface_17.Point)
point_16 = Point(evaluate_surface_18.Point)
data_29 = Data(point_14)
data_30 = Data(point_15)
data_31 = Data(point_16)
panel_4 = Panel("""Option
Occupant Load
Target Area
AAB / ADA
Adjacency
Secure / Non-Secure""")
number_slider_9 = Slider(0, range=0..100)
number_slider_10 = Slider(0, range=0..100)
data_32 = Data(point_12)
unit_x_2 = UnitX(Factor=1)
justifiedtext3d_10 = JustifiedText3d(
    Location=data_29,
    Text=panel_4,
    Size=Slider(0.12, range=0..1),
    HorizontalAlignment=number_slider_9,
    VerticalAlginment=number_slider_9,
    Font="Arial",
    UseMeshes=False,
    Bake=False)
panel_5 = Panel("""Option
Occupant Load
Target Area
AAB / ADA
Adjacency
Secure / Non-Secure""")
justifiedtext3d_11 = JustifiedText3d(
    Location=data_30,
    Text="Data",
    Size=Slider(0.14, range=0..1),
    HorizontalAlignment=Slider(2, range=0..10),
    VerticalAlginment=Slider(0, range=0..100),
    Font="Arial",
    UseMeshes=False,
    Bake=False)
justifiedtext3d_12 = JustifiedText3d(
    Location=data_31,
    Text="Description",
    Size=Slider(0.14, range=0..1),
    HorizontalAlignment=number_slider_10,
    VerticalAlginment=number_slider_10,
    Font="Arial",
    UseMeshes=False,
    Bake=False)
line_sdl_2 = LineSDL(Start=point_13, Direction=unit_x_2, Length=Slider(6.58, range=0..100))
list_length_2 = ListLength(List=panel_5)
series_2 = Series(Start=0, Step=Slider(0.2, range=0..1), Count=list_length_2)
unit_y_2 = UnitY(Factor=series_2)
reverse_2 = Reverse(Vector=unit_y_2)
move_2 = Move(Geometry=data_32, Motion=reverse_2)  # -> Geometry, Transform
justifiedtext3d_13 = JustifiedText3d(
    Location=move_2.Geometry,
    Text=panel_5,
    Size=Slider(0.12, range=0..1),
    HorizontalAlignment=Slider(2, range=0..10),
    VerticalAlginment=Slider(1, range=0..100),
    Font="Arial",
    UseMeshes=False,
    Bake=False)

data_33 = Data(data)
data_34 = Data(data)
data_35 = Data(data)
md_slider_19 = MDSlider(
    SliderMode=0,
    slider_value=Point(0.09931126645, 0.9040395585, 0.5),
    x_domain=Domain(0, 1),
    y_domain=Domain(0, 1),
    z_domain=Domain(0, 1))
md_slider_20 = MDSlider(
    SliderMode=0,
    slider_value=Point(0.8972964638, 0.06722160218, 0.5),
    x_domain=Domain(0, 1),
    y_domain=Domain(0, 1),
    z_domain=Domain(0, 1))
md_slider_21 = MDSlider(
    SliderMode=0,
    slider_value=Point(0.8969109786, 0.9013989645, 0.5),
    x_domain=Domain(0, 1),
    y_domain=Domain(0, 1),
    z_domain=Domain(0, 1))
evaluate_surface_19 = EvaluateSurface(Surface=reparameterize(data_33), Point=md_slider_19)  # -> Point, Normal, UDirection, VDirection, Frame
evaluate_surface_20 = EvaluateSurface(Surface=reparameterize(data_34), Point=md_slider_20)  # -> Point, Normal, UDirection, VDirection, Frame
evaluate_surface_21 = EvaluateSurface(Surface=reparameterize(data_35), Point=md_slider_21)  # -> Point, Normal, UDirection, VDirection, Frame
point_17 = Point(evaluate_surface_19.Point)
point_18 = Point(evaluate_surface_20.Point)
point_19 = Point(evaluate_surface_21.Point)
padtext_2 = PadText()
data_36 = Data(point_17)
data_37 = Data(point_18)
data_38 = Data(point_19)
number_slider_11 = Slider(0, range=0..100)
justifiedtext3d_14 = JustifiedText3d(
    Location=data_36,
    Text="Middleton Room Data Sheet",
    Size=Slider(0.11, range=0..1),
    HorizontalAlignment=number_slider_11,
    VerticalAlginment=number_slider_11,
    Font="Arial",
    UseMeshes=False,
    Bake=False)
justifiedtext3d_15 = JustifiedText3d(
    Location=data_37,
    Text="Pg XXX ",
    Size=Slider(0.11, range=0..1),
    HorizontalAlignment=Slider(2, range=0..10),
    VerticalAlginment=Slider(0, range=0..100),
    Font="Arial",
    UseMeshes=False,
    Bake=False)
justifiedtext3d_16 = JustifiedText3d(
    Location=data_38,
    Text="Room XX.XXX",
    Size=Slider(0.11, range=0..1),
    HorizontalAlignment=Slider(2, range=0..10),
    VerticalAlginment=Slider(0, range=0..100),
    Font="Arial",
    UseMeshes=False,
    Bake=False)

data_39 = Data(data)
md_slider_22 = MDSlider(
    SliderMode=0,
    slider_value=Point(0.5741108141, 0.8803610181, 0.5),
    x_domain=Domain(0, 1),
    y_domain=Domain(0, 1),
    z_domain=Domain(0, 1))
evaluate_surface_22 = EvaluateSurface(Surface=reparameterize(data_39), Point=md_slider_22)  # -> Point, Normal, UDirection, VDirection, Frame
point_20 = Point(evaluate_surface_22.Point)
negative_2 = Negative(Value=Slider(1.91, range=0..10))
rectangle_5 = Rectangle(Plane=point_20, XSize=Slider(2.65, range=0..10), YSize=negative_2, Radius=Slider(0.11, range=0..1))  # -> Rectangle, Length

# ==== cluster PadText: Component for adding leading or following zeros to numbers, can be used with any characters or any strings
left_rigth = ClusterInput()  # Toggle to pad left, or right.
text_to_pad = ClusterInput()  # Text or series of numbers you want to add leading or following characters to
character = ClusterInput()  # Character to insert in to the string, most commonly a zero
number_of_characters = ClusterInput()  # Number of leading or follwing characters to add to the string.
textpadder = CSharpScript(x=left_rigth, y=text_to_pad, z=number_of_characters, w=character)  # -> out, A; inputs x: Boolean, y: String, z: Int32, w: String
# ---------- textpadder: C# ----------
    String textConverted;
    char character = Convert.ToChar(w);
    String converted = y;
    Boolean leftOr = x;

    if (leftOr)
    {
      textConverted = converted.PadLeft(z, character);
    } else
    {
      textConverted = converted.PadRight(z, character);
    }

    A = textConverted;

    //String A = converted;
# ---------- end textpadder ----------
panel = Panel(textpadder.A)
A = ClusterOutput(textpadder.A)
